vi "frame.gvi"   [LabVIEW NXG 5.1.0]
inputs:
  "fs": i32 = 48000
  "frame length (ms)": i32 = 20
  "bitrate": i32 = 12000
outputs:
  "bytes per frame": i32
  "frame length (samples)": i32
diagram:
  Divide(x=$fs, y=1000) -> w1
  Multiply(w1, $"frame length (ms)") -> w2
  $"frame length (samples)" <- w2
  Divide(x=$bitrate, y=1000) -> w3
  Multiply(w3, $"frame length (ms)") -> w4
  Divide(x=w4, y=8) -> w5
  $"bytes per frame" <- w5
