vi "test.gvi"   [LabVIEW NXG 5.1.0]
panel indicators:
  "return": i32
  "data out": u8[]
  "return_3": i32
  "return_5": i32
  "pcm out": f32[]
  "output waveform": waveform<f32>
  "return_6": i32
uses:
  NI::G Core::Sound::Files::Sound File Read Simple.gvi
  opus-lv.sli::Opus Encode State Size
  opus-lv.sli::Opus Encode Init
  opus-lv.sli::Opus Encode
  opus-lv.sli::Opuis Decode State Size
  opus-lv.sli::Opus Decode Init
  opus-lv.sli::Opus Decode
  audio_write.sli::audio_write
  NI::Analysis::Generation::Gaussian White Noise.gvi
diagram:
  call "Sound File Read Simple.gvi"(sound file=path "C:\\Users\\jk\\Desktop\\test.wav", position offset=10000, number of samples/ch=96000) -> (data=w1)
  Array Index(array=w1) -> (out0[0]=w2)
  Property Node(instance in=w2) -> ("Y"=w3, "dt"=w4)
  To Single Precision Float(number=w3) -> w5
  call "Opus Encode State Size"() -> (return=w6)
  Initialize Array(element=0, size=w6) -> w7
  call "Opus Encode Init"(state in=w7, samplerate=48000, bitrate=12000) -> (state out=w8)
  call "frame.gvi"(fs=48000, bitrate=12000) -> (frame length (samples)=w9, bytes per frame=w10)
  Divide(x=96000, y=8) -> w11
  To Signed 32 Bit Integer(number=w11) -> w12
  Initialize Array(element=0, size=w12) -> w13
  call "Opus Encode"(state in=w8, pcm=w5, pcm_size=96000, frame_size=w9, data in=w13, max_data_bytes=w12) -> (return=w14, data out=w15)
  $return <- w14
  $"data out" <- w15
  call "Opuis Decode State Size"() -> (return=w16)
  Initialize Array(element=0, size=w16) -> w17
  call "Opus Decode Init"(state in=w17, samplerate=48000) -> (state out=w18)
  Initialize Array(element=0, size=96000) -> w19
  To Single Precision Float(number=w19) -> w20
  call "Opus Decode"(state in=w18, data=w15, data_bytes=w14, bytes_per_frame=w10, pcm in=w20, pcm_samples=96000) -> (return=w21, pcm out=w22)
  $return_5 <- w21
  $"pcm out" <- w22
  Build Waveform Node(Y=w22, dt=w4) -> (output waveform=w23)
  $"output waveform" <- w23
  call "audio_write"(dev=0, sr=48000, pcm=w22, samples in=w21) -> (return=w24)
  $return_6 <- w24
  disable {
    frame Enabled { }
    frame Disabled {
      while {
        call "Gaussian White Noise.gvi"(samples=44100, standard deviation=0.2) -> (Gaussian white noise=w25)
        To Single Precision Float(number=w25) -> w26
        call "audio_write"(dev=0, sr=44100, pcm=w26, samples in=1000) -> (return=w27)
        $return_3 <- w27
        stop if FALSE
      }
    }
  }
